% Simulink data dictionary IO.sldd

ADCBits = Simulink.Parameter(12, DataType="uint8", Unit="bits")  % ADC resolution on the target controller
Vref = Simulink.Parameter(5, DataType="uint8", Unit="V")  % Voltage reference used for analog to digital conversion